# Grasshopper definition weighted_overlay_revised.gh (Grasshopper 1.0.8)

path = FilePath("D:\Keon Chae\Workshop\JAH_PythonCircle\251113\terrain.py")
py3 = Python3Script(script=path)  # -> out, admin_district_list, geoms, areas, centroids; unedited script template
panel = Panel(py3.out)
panel_2 = Panel(py3.geoms)
panel_3 = Panel(py3.areas)
panel_4 = Panel(py3.centroids)
